# Grasshopper definition UWGWorkflow.gh (Grasshopper 1.0.5)

parkingtransitbuildings = Brep([<brep referenced from the Rhino model> x6])
# Import Urban
# Geometry
commercialbuildings = Brep([<brep referenced from the Rhino model> x13])
residentialbuildings = Brep([<brep referenced from the Rhino model> x30])
terrain = Brep(<brep referenced from the Rhino model>)
grass = Brep([<brep referenced from the Rhino model> x4])
trees = Brep([<brep referenced from the Rhino model> x178])

ladybug = Ladybug_Ladybug()  # -> Vviiiiiiiiiizzz; plug-in component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
dragonfly = Dragonfly_Dragonfly()  # -> Vviiiiiiiiiizzz; plug-in component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

item = ListItem(List=commercialbuildings, Index=Slider(50, range=0..100), Wrap=True)
python = GhPythonScript(building=item)  # -> out, curves; inputs building: Brep
# ---------- python: Python ----------
import Rhino as rc
import math
import scriptcontext as sc

def getFloorCrvs(buildingMass, floorHeight=3.05):
    #Draw a bounding box around the mass and use the lowest Z point to set the base point.
    massBB = buildingMass.GetBoundingBox(rc.Geometry.Plane.WorldXY)
    fullRange = massBB.Max.Z - massBB.Min.Z
    numCrvs = int(math.floor(fullRange / floorHeight))
    flrRanges = range(0, numCrvs)
    flrHeights = [x*floorHeight + massBB.Min.Z for x in flrRanges]
    
    floorBreps = []
    floorArea = 0
    for count, h in enumerate(flrHeights):
        floorBasePt = rc.Geometry.Point3d(0,0,h)
        sectionPlane = rc.Geometry.Plane(floorBasePt, rc.Geometry.Vector3d.ZAxis)
        floorCrvs = rc.Geometry.Brep.CreateContourCurves(buildingMass, sectionPlane)
        floorBrep = rc.Geometry.Brep.CreatePlanarBreps(floorCrvs, sc.doc.ModelAbsoluteTolerance)
        floorArea += rc.Geometry.AreaMassProperties.Compute(floorBrep).Area
        floorBreps.extend(floorBrep)
    print floorArea
    
    return floorBreps

if building != None:
    curves = getFloorCrvs(building)
# ---------- end python ----------
# 1
toggle = BooleanToggle(True)

# ----
# Visualize Urban Area
swatch = ColourSwatch(SwatchColor=RGB(82, 82, 82))
preview = CustomPreview(Geometry=terrain, Shader=swatch)
preview_2 = CustomPreview(Geometry=grass, Shader=ColourSwatch(SwatchColor=RGB(118, 168, 133)))
preview_3 = CustomPreview(Geometry=trees, Shader=ColourSwatch(SwatchColor=RGB(40, 102, 58)))
preview_4 = CustomPreview(Geometry=commercialbuildings, Shader=ColourSwatch(SwatchColor=RGB(95, 100, 178)))
preview_5 = CustomPreview(Geometry=residentialbuildings, Shader=ColourSwatch(SwatchColor=RGB(235, 206, 94)))
preview_6 = CustomPreview(Geometry=parkingtransitbuildings, Shader=ColourSwatch(SwatchColor=RGB(143, 143, 143)))

bldgprograms = Dragonfly_bldgPrograms({"FullServiceRestaurant", "Hospital", "LargeHotel", "LargeOffice", "MediumOffice", "MidRiseApartment", "OutPatient", "PrimarySchool", "QuickServiceRestaurant", "SecondarySchool", "SmallHotel", "SmallOffice", "StandAloneRetail", "StripMall", "SuperMarket", "Warehouse"}, selected="MidRiseApartment")
# Define Building Typologies
bldgprograms_2 = Dragonfly_bldgPrograms({"FullServiceRestaurant", "Hospital", "LargeHotel", "LargeOffice", "MediumOffice", "MidRiseApartment", "OutPatient", "PrimarySchool", "QuickServiceRestaurant", "SecondarySchool", "SmallHotel", "SmallOffice", "StandAloneRetail", "StripMall", "SuperMarket", "Warehouse"}, selected="LargeOffice")
bldgprograms_3 = Dragonfly_bldgPrograms({"FullServiceRestaurant", "Hospital", "LargeHotel", "LargeOffice", "MediumOffice", "MidRiseApartment", "OutPatient", "PrimarySchool", "QuickServiceRestaurant", "SecondarySchool", "SmallHotel", "SmallOffice", "StandAloneRetail", "StripMall", "SuperMarket", "Warehouse"}, selected="Warehouse")
bldgage = Dragonfly_bldgPrograms({"Pre-1980's": 0, "1980's-Present": 1, "New Construction": 2}, selected="Pre-1980's")
bldgage_2 = Dragonfly_bldgPrograms({"Pre-1980's": 0, "1980's-Present": 1, "New Construction": 2}, selected="1980's-Present")
bldgage_3 = Dragonfly_bldgPrograms({"Pre-1980's": 0, "1980's-Present": 1, "New Construction": 2}, selected="1980's-Present")
bldgtypology = Dragonfly_UWGBuildingTypology(bldgGeo=commercialbuildings, bldgProgram=bldgprograms_2, bldgAge=bldgage_2, floor2Floor="4", runIt=toggle)  # -> readMe, port, buildingTypology, port_2, bldgFootprints, facadeBreps; plug-in component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

vegpar = Dragonfly_VegetationParameters(vegetationAlbedo="0.5")  # -> vegetationPar; plug-in component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
pavementpar = Dragonfly_PavementParameters(albedo="0.25")  # -> pavementPar; plug-in component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
trafficpar = Dragonfly_TrafficParameters(sensibleHeat="10")  # -> trafficPar; plug-in component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

panel = Panel(bldgtypology.readMe)
exportladybug = Ladybug_ExportLadybug(targetFolder="C:\Users\cmackey\Documents\GitHub\Dragonfly\newPlugin", export=Toggle(False))  # -> readMe; plug-in component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
# 2
toggle_2 = BooleanToggle(False)
# Define the City
uwgcity = Dragonfly_UWGCity(
    buildingTypologies=flatten(bldgtypology.buildingTypology),
    terrainBrep=flatten(terrain),
    treesOrCoverage=flatten(trees),
    grassOrCoverage=flatten(grass),
    trafficPar=trafficpar,
    vegetationPar=vegpar,
    pavementPar=pavementpar,
    runIt=toggle_2)  # -> readMe, port, UWGCity, port_2, treeFootprints, grassFootprints, terrainSrf; plug-in component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
panel_2 = Panel(uwgcity.readMe)

# ----
# Import Climate Data
panel_3 = Panel("http://apps1.eere.energy.gov/buildings/energyplus/weatherdata/4_north_and_central_america_wmo_region_4/1_usa/USA_FL_Miami.Intl.AP.722020_TMY3.zip")
epw_stat = Ladybug_OpenEPWAndSTATWeatherFiles(weatherFileURL=panel_3)  # -> epwFile, statFile; plug-in component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

# ----
# 3
toggle_3 = BooleanToggle(False)

boundarylayerpar = Dragonfly_BoundaryLayerParameters()  # -> boundLayerPar; plug-in component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
# Run the UWG
refepwpar = Dragonfly_ReferenceEPWParameters(vegetationCoverage="0.8")  # -> epwSitePar; plug-in component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
runuwg = Dragonfly_RunUrbanWeatherGenerator(
    epwFile=epw_stat.epwFile,
    UWGCity=uwgcity.UWGCity,
    epwSitePar=refepwpar,
    boundLayerPar=boundarylayerpar,
    writeFile=toggle_3,
    runUWG=toggle_3)  # -> readMe, port, uwgFileAddress, epwFileAddress, port_2, uwgText; plug-in component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
